# Grasshopper definition check_urdf.ghx (Grasshopper 1.0.7)

panel = Panel("Check URDF")
py = GhPythonScript()  # -> filepath
# ---------- py: Python ----------
import os

filename = ghenv.Component.OnPingDocument().FilePath

filepath = os.path.join(os.path.dirname(filename), "..")

filepath = os.path.abspath(filepath)
print filepath
# ---------- end py ----------
panel_2 = Panel(py)
python = GhPythonScript(filepath=py, urdf_filename="catkin\princeton_cell\urdf\full_cell.urdf", path="catkin")  # -> urdf_filename, path
# ---------- python: Python ----------
import os


urdf_filename = os.path.join(filepath, urdf_filename)
path = os.path.join(filepath, path)

print urdf_filename
# ---------- end python ----------
python_2 = GhPythonScript(urdf_filename=python.urdf_filename, path=python.path, load_geometry=Toggle(True))  # -> model
# ---------- python_2: Python ----------
from compas.robots import LocalPackageMeshLoader
from compas.robots import RobotModel

model = RobotModel.from_urdf_file(urdf_filename)

if load_geometry:
    loaders = [LocalPackageMeshLoader(path, 'princeton_cell')]
    loaders.append(LocalPackageMeshLoader(path, 'abb_irb4600_40_255'))
    model.load_geometry(*loaders)
# ---------- end python_2 ----------
python_3 = GhPythonScript(model=python_2)  # -> G
# ---------- python_3: Python ----------
from compas_ghpython.artists import RobotModelArtist

artist = RobotModelArtist(model)


G = artist.draw_visual()
# ---------- end python_3 ----------
